# Grasshopper definition ConnectToServer.gh (Grasshopper 1.0.5)

c_script = CSharpScript(
    x=Button(),
    Reference="C:\Users\epoulsen\Documents\GitHub\GrasshopperLive\src\csharp\GrasshopperLive.Core\bin\Debug\GrasshopperLive.Core.dll")  # -> out, A; inputs x: Boolean
# ---------- c_script: C# ----------
    if(x)
    {
      ghLive = new GrasshopperLive.GrasshopperLive();
      ghLive.DataReceived += GhLive_DataReceived;
      ghLive.Connect();
    }
    A = _log;
# ---------- c_script: C# additional code ----------
  List<string> _log = new List<string>();

  private void GhLive_DataReceived(object sender, GhLiveEventArgs e)
  {
    //System.Windows.Forms.MessageBox.Show(e.TheObject.Message);

    //_messageLog.Add(e.TheObject.Message);
    //Grasshopper.Instances.DocumentEditor. //BeginInvoke(new Action(() => { GH_JoinSession.Application.ExpireSolution(true); }));
    //GH_JoinSession.Application.ExpireSolution(true);
    _log.Add(e.TheObject.Message);
    //Component.ExpireSolution(true);
    //Component.ExpireSolution(true);
    //GrasshopperDocument.NewSolution(true);

    //Grasshopper.GUI.Canvas.GH_Canvas canvas = Grasshopper.Instances.ActiveCanvas;

    Grasshopper.Instances.DocumentEditor.BeginInvoke(new Action(() => { Component.ExpireSolution(true); }));



  }
  GrasshopperLive.GrasshopperLive ghLive;
# ---------- end c_script ----------
panel = Panel(c_script.A)
