# Grasshopper definition ConnectToServer_Paul.gh (Grasshopper 1.0.7)

c_script = CSharpScript(
    x=Button(),
    Reference=["C:\Users\Paul\Documents\GitHub\myWebsite\GrasshopperLive\src\csharp\GrasshopperLive.Core\bin\Debug\GrasshopperLive.Core.dll", "C:\Program Files\Rhino 6\Plug-ins\Grasshopper\Components\CurveComponents.gha"])  # -> out, A; inputs x: Boolean
# ---------- c_script: C# usings ----------
using System.IO;
using System.Linq;
using System.Data;
using System.Drawing;
using System.Reflection;
using System.Windows.Forms;
using System.Xml;
using System.Xml.Linq;
using System.Runtime.InteropServices;

using Rhino.DocObjects;
using Rhino.Collections;
using GH_IO;
using GH_IO.Serialization;
using GrasshopperLive;
# ---------- c_script: C# ----------
    if(x)
    {
      ghLive = new GrasshopperLive.GrasshopperLive();
      ghLive.DataReceived += GhLive_DataReceived;
      ghLive.Connect();
    }
    A = _log;
# ---------- c_script: C# additional code ----------
  List<string> _log = new List<string>();

  private void GhLive_DataReceived(object sender, GhLiveEventArgs e)
  {
    //System.Windows.Forms.MessageBox.Show(e.TheObject.Message);




    //_messageLog.Add(e.TheObject.Message);
    //Grasshopper.Instances.DocumentEditor. //BeginInvoke(new Action(() => { GH_JoinSession.Application.ExpireSolution(true); }));
    //GH_JoinSession.Application.ExpireSolution(true);
    _log.Add(e.TheObject.Message);
    //Component.ExpireSolution(true);
    //Component.ExpireSolution(true);
    //GrasshopperDocument.NewSolution(true);

    //Grasshopper.GUI.Canvas.GH_Canvas canvas = Grasshopper.Instances.ActiveCanvas;

    Grasshopper.Instances.DocumentEditor.BeginInvoke(new Action(() => {


      //----------------------------------
      /*
      CurveComponents.Component_CircleCNR cs = new CurveComponents.Component_CircleCNR();

      cs.CreateAttributes();
      cs.Attributes.Pivot = new System.Drawing.PointF(100, 100);
      //cs.Attributes.Pivot.Y = 10;

      GH_Document doc = Grasshopper.Instances.ActiveCanvas.Document;
      IList<IGH_DocumentObject> documentObjects = doc.Objects;
      doc.AddObject(cs, false, 1);
      //----------------------------------
      */

      Component.ExpireSolution(true);

      }));



  }
  GrasshopperLive.GrasshopperLive ghLive;
# ---------- end c_script ----------
c_script_2 = CSharpScript(
    x=Button(),
    Reference=["C:\Users\Paul\Documents\GitHub\myWebsite\GrasshopperLive\src\csharp\GrasshopperLive.Core\bin\Debug\GrasshopperLive.Core.dll", "C:\Program Files\Rhino 6\Plug-ins\Grasshopper\Components\CurveComponents.gha"])  # -> out, A; inputs x: Boolean; same code as c_script
panel = Panel(c_script.A)
panel_2 = Panel(c_script_2.A)
