# Grasshopper definition ConnectToServer_Paul2.gh (Grasshopper 1.0.5)

# ---- group: Document Events
c_script = CSharpScript(x=Toggle(False))  # -> out, A, B, C, D, E
# ---------- c_script: C# ----------
    Print("Document Name: " + GrasshopperDocument.DisplayName);

    // string name = "Charlie";
    // GrasshopperDocument.ObjectsAdded += GrasshopperDocument.ObjectsAddedEventHandler;

    // subscribe to OnObjects Added
    GrasshopperDocument.ObjectsAdded += ObjectsAddedEvent;

    GrasshopperDocument.OnObjectsAdded(GrasshopperDocument.Objects);

    // unsubscribe to OnObjects Added
    GrasshopperDocument.ObjectsAdded -= ObjectsAddedEvent;

    //
    GrasshopperDocument.ModifiedChanged += ModifiedEvent;
    GrasshopperDocument.OnModifiedChanged();
    GrasshopperDocument.ModifiedChanged -= ModifiedEvent;

    //GrasshopperDocument.ObjectsAdded();
# ---------- c_script: C# additional code ----------
  void ObjectsAddedEvent (object sender, EventArgs e){
    Print("Sender: {0} | EventArgs: {1}", sender.GetType().ToString(), e.GetType().ToString());

    Grasshopper.Kernel.GH_Document doc = (Grasshopper.Kernel.GH_Document) sender;
    Grasshopper.Kernel.GH_DocObjectEventArgs args = (Grasshopper.Kernel.GH_DocObjectEventArgs) e;

    Print("Number of objects on canvas: " + args.ObjectCount.ToString());
    Print("Object type: " + args.Objects[args.ObjectCount - 1].GetType().ToString());
    Print(args.Objects[args.ObjectCount - 1].Name);

    try{
      var obj = args.Objects[args.ObjectCount - 1];
      Grasshopper.Kernel.GH_Component comp = (Grasshopper.Kernel.GH_Component) obj;
      //Print("Location: {0} | {1}", comp.Attributes..Attributes.Pivot.X.ToString(), comp2.Attributes.Pivot.Y.ToString());

      IGH_Component comp2 = (IGH_Component) obj;
      Print("Location2: {0} | {1}", comp2.Attributes.Pivot.X.ToString(), comp2.Attributes.Pivot.Y.ToString());
      Print("Component ID: " + comp2.ComponentGuid.ToString());
    } catch (Exception ex){
      Print(ex.Message);
    }

    GrasshopperDocument.ExpireSolution();
  }


  void ModifiedEvent(object sender, EventArgs e){
    Print("Sender: {0} | EventArgs: {1}", sender.GetType().ToString(), e.GetType().ToString());

    Grasshopper.Kernel.GH_Document doc = (Grasshopper.Kernel.GH_Document) sender;
    Grasshopper.Kernel.GH_DocModifiedEventArgs args = (Grasshopper.Kernel.GH_DocModifiedEventArgs) e;

    Print("Document Modified: " + args.Modified);
  }
# ---------- end c_script ----------
panel = Panel(c_script.out)
panel_2 = Panel(c_script.A)

# ----
c_script_2 = CSharpScript(
    x=Button(),
    Reference=["C:\Users\epoulsen\Documents\GitHub\GrasshopperLive\src\csharp\GrasshopperLive.Core\bin\Debug\GrasshopperLive.Core.dll", "C:\Program Files\Rhino 6\Plug-ins\Grasshopper\Components\CurveComponents.gha"])  # -> out, A; inputs x: Boolean
# ---------- c_script_2: C# ----------
    if(x)
    {
      if(!subscribed)
      {
        GrasshopperDocument.ObjectsAdded += ObjectsAddedEvent;
        GrasshopperDocument.ObjectsDeleted += ObjectsDeletedEvent;
        subscribed = true;
      }

      //GrasshopperDocument.OnObjectsAdded(GrasshopperDocument.Objects);


      GrasshopperLive.GrasshopperLive ghLive;
      ghLive = new GrasshopperLive.GrasshopperLive();
      ghLive.DataReceived += GhLive_DataReceived;
      ghLive.Connect();
      _id = ghLive.SocketId;
      _log.Add("senderId: " + _id);
      _ghLive = ghLive;
    }
    A = _log;
# ---------- c_script_2: C# additional code ----------
  Dictionary<Guid, Guid> _customIdToInstanceIdMap = new Dictionary<Guid, Guid>();

  public void ObjectsDeletedEvent(object sender, GH_DocObjectEventArgs e)
  {
    AddItem("item deleted: " + e.ObjectCount);

    foreach (IGH_DocumentObject item in e.Objects)
    {
      var guid = item.InstanceGuid;
      var customGuid = FindKeyFromValue(guid);
      //AddItem("to be deleted: " + customGuid);
      if(customGuid != Guid.Empty){
        _ghLive.SendDeleteUpdateMessage(customGuid);
      }
    }
    //Grasshopper.Instances.DocumentEditor.BeginInvoke(new Action(() => { Component.ExpireSolution(true); }));
    //

  }

  public Guid FindKeyFromValue(Guid gVal)
  {
    foreach (var pair in _customIdToInstanceIdMap)
    {
      if(pair.Value == gVal){
        return pair.Key;
      }
    }
    return Guid.Empty;
  }

  public void AddItem(string item)
  {
    _log.Insert(0, item);
  }

  bool subscribed = false;
  List<string> _log = new List<string>();
  string _id;
  GrasshopperLive.GrasshopperLive _ghLive;

  void ObjectsAddedEvent (object sender, EventArgs e){

    Grasshopper.Kernel.GH_Document doc = (Grasshopper.Kernel.GH_Document) sender;
    Grasshopper.Kernel.GH_DocObjectEventArgs args = (Grasshopper.Kernel.GH_DocObjectEventArgs) e;

    try{
      var obj = args.Objects[args.ObjectCount - 1];
      Grasshopper.Kernel.GH_Component comp = (Grasshopper.Kernel.GH_Component) obj;
      var addedGuid = comp.InstanceGuid;

      if(addedGuid == _lastAdded) return;
      if(_ghLive == null) return;
      string addedMsg = "object added event: " + addedGuid.ToString();

      Guid generatedGuid = Guid.NewGuid();

      AddItem(addedMsg);

      double x = comp.Attributes.Pivot.X;
      double y = comp.Attributes.Pivot.Y;

      var type = comp.GetType().ToString();

      GhLivePoint pt = new GhLivePoint();
      pt.X = x;
      pt.Y = y;

      if(!_customIdToInstanceIdMap.ContainsKey(generatedGuid))
      {
        _customIdToInstanceIdMap.Add(generatedGuid, addedGuid);
      }

      _ghLive.SendAddUpdateMessage(type, generatedGuid, pt);

    } catch (Exception){
      //Print(ex.Message);
    }
    GrasshopperDocument.ExpireSolution();
  }


  Guid _lastAdded;
  Guid _lastDeleted;

  private void GhLive_DataReceived(object sender, GhLiveEventArgs e)
  {
    AddItem("sender:  " + e.TheObject.Sender + " " + e.TheObject.Message);
    if(e.TheObject.Sender == _id){
      _log.Add("not creating a component!");
      return;
    }

    if(e.TheObject.UpdateType == UpdateType.Add)
    {
      AddComponent((float) e.TheObject.Point.X, (float) e.TheObject.Point.Y,
        e.TheObject.Type, e.TheObject.CustomId);
    }
    if(e.TheObject.UpdateType == UpdateType.Delete)
    {
      DeleteComponent(e.TheObject.CustomId);
    }

    Grasshopper.Instances.DocumentEditor.BeginInvoke(new Action(() => { Component.ExpireSolution(true); }));

  }

  public void DeleteComponent(Guid customGuid)
  {
    GH_Document doc = Grasshopper.Instances.ActiveCanvas.Document;
    var componentToDelete = GetComponentFromGuid(customGuid);
    if(componentToDelete != null)
    {
      AddItem("Deleting component: " + componentToDelete.Name);
      doc.RemoveObject(componentToDelete, false);

    }

  }

  private IGH_DocumentObject GetComponentFromGuid(Guid guidToDelete){
    if(!_customIdToInstanceIdMap.ContainsKey(guidToDelete)) return null;

    var instanceGuid = _customIdToInstanceIdMap[guidToDelete];

    GH_Document doc = Grasshopper.Instances.ActiveCanvas.Document;
    IList<IGH_DocumentObject> documentObjects = doc.Objects;

    foreach (IGH_DocumentObject item in documentObjects)
    {
      if(item.InstanceGuid == instanceGuid)
      {
        return item;
      }
    }

    return null;

  }

  public void AddComponent(float x, float y, string type, Guid id)
  {
    if(_customIdToInstanceIdMap.ContainsKey(id))
    {
      return; //it has already been added! return..
    }
    GH_Component cs = GetNewComponent(type);

    cs.CreateAttributes();
    cs.Attributes.Pivot = new System.Drawing.PointF(x, y);

    GH_Document doc = Grasshopper.Instances.ActiveCanvas.Document;
    IList<IGH_DocumentObject> documentObjects = doc.Objects;
    _lastAdded = cs.InstanceGuid;

    _customIdToInstanceIdMap.Add(id, cs.InstanceGuid);

    bool IsAdded = doc.AddObject(cs, false, 1);

  }

  private GH_Component GetNewComponent(string st)
  {
    
    
    GH_Component cs = null;
    
    // Get type from string
    string assembly = st.Split('.')[0];
    Type objectType = Type.GetType(st + ", " + assembly);


    var A = objectType;
    // Get assembly from type
    string AssemblyName = objectType.Assembly.GetName().Name;

    // Instantiate from type
    dynamic myInstance = Activator.CreateInstance(AssemblyName, st).Unwrap();
    
    if(myInstance != null){
      return (GH_Component) myInstance;
    } else
    {
      return cs;    
    }
    

//    if(type == typeof(Component_CircleCNR).ToString())
//    {
//      cs = new Component_CircleCNR();
//    } else if(type == typeof(Component_Arc3Pt).ToString()){
//      cs = new Component_Arc3Pt();
//    }
//    else if(type == typeof(Component_Arc2).ToString()){
//      cs = new Component_Arc2 ();
//    }
//    else if(type == typeof(Component_Arc).ToString()){
//      cs = new Component_Arc();
//    }
//    else
//    {
//      cs = new CurveComponents.Component_CircleCNR();
//    }

    //return cs;
  }
# ---------- end c_script_2 ----------
panel_3 = Panel(c_script_2.A)
