# Grasshopper definition GenerateComponentBasedOnType.gh (Grasshopper 1.0.7)

txt = Text("CurveComponents.Component_Circle")
c_script = CSharpScript(
    StringType=txt,
    Reference=["C:\Users\Paul\Documents\GitHub\myWebsite\GrasshopperLive\src\csharp\GrasshopperLive.Core\bin\Debug\GrasshopperLive.Core.dll", "C:\Program Files\Rhino 6\Plug-ins\Grasshopper\Components\CurveComponents.gha"])  # -> out, A; inputs StringType: list of String
# ---------- c_script: C# usings ----------
using System.IO;
using System.Linq;
using System.Data;
using System.Drawing;
using System.Reflection;
using System.Windows.Forms;
using System.Xml;
using System.Xml.Linq;
using System.Runtime.InteropServices;

using Rhino.DocObjects;
using Rhino.Collections;
using GH_IO;
using GH_IO.Serialization;
using GrasshopperLive;
using OtherComponents;
using FilletEdgeComponents;
using DimensionComponents;
using CurveComponents;
using CurveComponents.Offset;
using CurveComponents.GLShader;
using AnalysisComponents;
# ---------- c_script: C# ----------
    foreach(string st in StringType){

      // Get type from string
      string assembly = st.Split('.')[0];
      Type objectType = Type.GetType(st + ", " + assembly);


      A = objectType;
      // Get assembly from type
      string AssemblyName = objectType.Assembly.GetName().Name;

      // Instantiate from type
      dynamic myInstance = Activator.CreateInstance(AssemblyName, st).Unwrap();

      // Create basic attributes
      myInstance.CreateAttributes();
      myInstance.Attributes.Pivot = new System.Drawing.PointF(100, 100);

      // Add Component to Doc
      GH_Document doc = Grasshopper.Instances.ActiveCanvas.Document;
      bool IsAdded = doc.AddObject(myInstance, false, 1);

    }
# ---------- end c_script ----------
