# Grasshopper definition RetrieveBasicInfoFromComponent.gh (Grasshopper 1.0.7)

c_script = CSharpScript()  # -> out, A
# ---------- c_script: C# ----------
    GH_Document doc = Grasshopper.Instances.ActiveCanvas.Document;
    IList<IGH_DocumentObject> documentObjects = doc.Objects;
    
    foreach(IGH_DocumentObject docObj in documentObjects){
      
      // Component IDs in Doc
      Guid docObj_CompID = docObj.ComponentGuid;
      
      // Instance IDs in Doc
      Guid docObj_InstanceID = docObj.InstanceGuid;
      
      // Location on Canvas
      System.Drawing.PointF docObj_pivotPos = docObj.Attributes.Pivot;
      
      // Component's Name
      string docObj_Name = docObj.Name;
      
      
      if (docObj is IGH_Component){
        Print("Component");
        
        IGH_Component myComponent = (IGH_Component)docObj;
        GH_ComponentParamServer myParams = myComponent.Params;
        
        // Component's List of Params Outputs
        List<IGH_Param> myParamsOutputs = myParams.Output;
        foreach(IGH_Param output in myParamsOutputs){
          IList<IGH_Param> sources = output.Sources;
        }
        
        // Component's List of Params Inputs
        List<IGH_Param> myParamsInputs = myParams.Input;
        foreach(IGH_Param input in myParamsInputs){
          IList<IGH_Param> recipients = input.Recipients;
        }
        
      }
      
        
      else if (docObj is IGH_Param){ // Panels, sliders, containers etc...
        
        IGH_Param myCompLikeParam = (IGH_Param)docObj;
        IList<IGH_Param> sources = myCompLikeParam.Sources;
        IList<IGH_Param> recipients = myCompLikeParam.Recipients;
        
      }
      
    }
# ---------- end c_script ----------
